# Grasshopper definition 01.ghx (Grasshopper 1.0.4)

shift = ShiftList(Shift=1, Wrap=True)
shift_2 = ShiftList(Shift=1, Wrap=True)
extr = Extrude()
radius = Slider(13.5, range=0..50)
count = Slider(19, range=0..50)
shift_3 = Slider(1, range=0..50)
pt = ConstructPoint(XCoordinate=Slider(0, range=0..50), YCoordinate=Slider(0, range=0..50), ZCoordinate=Slider(0, range=0..50))
cir = Circle(Plane=pt, Radius=radius)
height = Slider(9, range=0..50)
divide = DivideCurve(Curve=cir, Count=count, Kinks=False)  # -> Points, Tangents, Parameters
shift_4 = ShiftList(List=divide.Points, Shift=shift_3, Wrap=Toggle(True))
ln = Line(StartPoint=divide.Points, EndPoint=shift_4)
line = Line(ln)

Z = UnitZ(Factor=height)
boundary = BoundarySurfaces(Edges=line)
move = Move(Geometry=boundary, Motion=Z)  # -> Geometry, Transform
extr_2 = Extrude(Base=line, Direction=Z)
join = BrepJoin(Breps=[boundary, extr_2, move.Geometry])  # -> Breps, Closed
