# Grasshopper definition 02.ghx (Grasshopper 1.0.4)

point_array_1 = Panel("""0,20,0
5,20,0
10,20,0
15,20,0
20,20,0
25,20,0
30,20,0
35,20,0
40,20,0
45,20,0
50,20,0""")
point_array_2 = Panel("""0,0,0
5,0,0
10,0,0
15,0,0
20,0,0
25,0,0
30,0,0
35,0,0
40,0,0
45,0,0
50,0,0
55,0,0""")
pt = Point(point_array_1)
pt_2 = Point(point_array_2)
short = ShortestList(ListA=pt, ListB=pt_2, TrimMode=2)  # -> ListA, ListB
long = LongestList(ListA=pt, ListB=pt_2, PaddingMode=2)  # -> ListA, ListB
crossref = CrossReference(ListA=pt, ListB=pt_2, CrossMode=1)  # -> ListA, ListB
ln = Line(StartPoint=pt, EndPoint=pt_2)  # disabled
ln_2 = Line(StartPoint=short.ListA, EndPoint=short.ListB)  # disabled
ln_3 = Line(StartPoint=long.ListA, EndPoint=long.ListB)  # disabled
ln_4 = Line(StartPoint=crossref.ListA, EndPoint=crossref.ListB)  # disabled
shift = ShiftList(Shift=Slider(0, range=0..10), Wrap=Toggle(True))
ln_5 = Line()
