# Grasshopper definition 03.ghx (Grasshopper 1.0.4)

panel = Panel("""-3,36,0
-37,31,0
-23,31,0
-16,35,0
-31,36,0
-50,33,0
-41,27,0
-53,22,0
-32,25,0
-58,16,0""")
pt = Point(panel)
sort_pt = SortPoints(Points=pt)  # -> Points, Indices
nurbs = NurbsCurve(Vertices=pt, Degree=3, Periodic=False)  # -> Curve, Length, Domain; disabled
pdecon = Deconstruct(Point=sort_pt.Points)  # -> XComponent, YComponent, ZComponent
nurbs_2 = NurbsCurve(Vertices=sort_pt.Points, Degree=3, Periodic=False)  # -> Curve, Length, Domain; disabled
panel_2 = Panel(sort_pt.Points)
pt_2 = ConstructPoint(XCoordinate=pdecon.YComponent, YCoordinate=pdecon.XComponent, ZCoordinate=pdecon.ZComponent)
sort_pt_2 = SortPoints(Points=pt_2)  # -> Points, Indices
pdecon_2 = Deconstruct(Point=sort_pt_2.Points)  # -> XComponent, YComponent, ZComponent
pt_3 = ConstructPoint(XCoordinate=pdecon_2.YComponent, YCoordinate=pdecon_2.XComponent, ZCoordinate=pdecon_2.ZComponent)
panel_3 = Panel(pt_2)
nurbs_3 = NurbsCurve(Vertices=pt_3, Degree=3, Periodic=False)  # -> Curve, Length, Domain
panel_4 = Panel(pt_3)
