# Grasshopper definition 04.ghx (Grasshopper 1.0.4)

crv = Curve()
crv_2 = Curve(reparameterize([<curve referenced from the Rhino model> x3]))
eval = EvaluateCurve(Curve=crv_2, Parameter=Slider(0.35, range=0..1))  # -> Point, Tangent, Angle
