# Grasshopper definition 05.ghx (Grasshopper 1.0.4)

pt = ConstructPoint(XCoordinate=Slider(0.18, range=0..1), YCoordinate=Slider(0.5, range=0..1), ZCoordinate=0)
srf = Surface(reparameterize(<surface referenced from the Rhino model>))
evalsrf = EvaluateSurface(Surface=srf, Point=pt)  # -> Point, Normal, Frame
