# Grasshopper definition 06.ghx (Grasshopper 1.0.4)

number_slider = Slider(0.723, range=0..1)
number_slider_2 = Slider(0.23, range=0..1)
srf = Surface(reparameterize(<surface referenced from the Rhino model>))
dom²num = ConstructDomain²(UMin=number_slider_2, UMax=number_slider, VMin=number_slider_2, VMax=number_slider)
subsrf = Isotrim(Surface=srf, Domain=dom²num)
