# Grasshopper definition 07.ghx (Grasshopper 1.0.4)

number_slider = Slider(5.574, range=0..6)
srf = Surface(reparameterize(<surface referenced from the Rhino model>))
sdivide = DivideSurface(Surface=srf, UCount=number_slider, VCount=number_slider)  # -> Points, Normals, Parameters
panel = Panel(sdivide.Parameters)
