# Grasshopper definition 08.ghx (Grasshopper 1.0.4)

xz = XZPlane(Origin=Point(0, 0, 0))
crv = Curve(<curve referenced from the Rhino model>)
mirror = Mirror(Geometry=crv, Plane=xz)  # -> Geometry, Transform
join = JoinCurves(Curves=[crv, mirror.Geometry], Preserve=False)
rotate = Rotate(Geometry=join, Angle=expr("Rad(x)", Slider(360, range=0..360)), Plane=PlaneXY(0, 0, 0))  # -> Geometry, Transform
