# Grasshopper definition Untitled.ghx (Grasshopper 1.0.4)
# plug-ins: SurfaceRays, SonicTargetRays, SonicRefract

pt = Point("5,0,-10")
pt_2 = Point("5,0,10")
srf = Surface(<surface referenced from the Rhino model>)
surfacerays = SurfaceRays()  # -> Points, Vectors, Normals, UVs, Srfs, SrfUVs, SrfInd, SrfCull, Curves
targetrays = TargetRays(SourcePts=pt, TargetPts=pt_2, Surfaces=srf, Bounces=Slider(0, range=0..10))  # -> Points, Vectors, Normals, UVs, Srfs, SrfUVs, SrfInd, SrfCull, Curves; disabled
refract = Refraction(SourcePts=pt, TargetPts=pt_2, Surfaces=srf, Ni=Slider(0.25, range=0..1), Nr=Slider(0.34, range=0..1), Solid=Toggle(True))  # -> Points, Vectors, Normals, SrfInd, Curves, Ang
