# Grasshopper definition refraction.ghx (Grasshopper 1.0.4)
# plug-ins: SurfaceRays, SonicTargetRays, SonicRefract

panel = Panel("""5,0,10
2,3,10
4,-2,10
8,1,10
-4,3,10""")
panel_2 = Panel("""5,0,-10
2,3,-10
4,-2,-10
8,1,-10
-4,3,-10""")
srf = Surface(<surface referenced from the Rhino model>)
pt = Point(panel_2)
pt_2 = Point(panel)
srf_2 = Surface(<surface referenced from the Rhino model>)
surfacerays = SurfaceRays()  # -> Points, Vectors, Normals, UVs, Srfs, SrfUVs, SrfInd, SrfCull, Curves; disabled
targetrays = TargetRays(SourcePts="5,0,10", TargetPts="5,0,30", Surfaces=srf, Bounces=Slider(9, range=0..10))  # -> Points, Vectors, Normals, UVs, Srfs, SrfUVs, SrfInd, SrfCull, Curves; disabled
refract = Refraction(SourcePts=pt, TargetPts=pt_2, Surfaces=srf_2, Ni=Slider(1, range=0..1), Nr=Slider(1.51, range=0..2), Solid=Toggle(True))  # -> Points, Vectors, Normals, SrfInd, Curves, Ang
